# Grasshopper definition Test_01.gh (Grasshopper 1.0.7)
# plug-ins: Triceratops

geo = Geometry(<subd referenced from the Rhino model>)
brep = Brep(geo)
mesh = MeshBrep(
    Brep=brep,
    Settings={GridMaxCount=0, GridMinCount=16, JaggedSeams=False, MaxEdgeLength=0, MinEdgeLength=0.0001, MinTolerance=0, Refine=True, RefineAngle=0, RelativeTolerance=0.65, SimplePlanes=True, Tolerance=0})
demesh = DeconstructMesh(Mesh=mesh)  # -> Vertices, Faces, Colours, Normals
X = UnitX(Factor=1)
Y = UnitY(Factor=1)
Z = UnitZ(Factor=1)
dprod = DotProduct(VectorA=demesh.Normals, VectorB=X, Unitize=invert(False))
dprod_2 = DotProduct(VectorA=demesh.Normals, VectorB=Y, Unitize=invert(False))
dprod_3 = DotProduct(VectorA=demesh.Normals, VectorB=Z, Unitize=invert(False))
bnd = Bounds(Numbers=flatten([dprod, dprod_2, dprod_3]))
geo_2 = Geometry(<subd referenced from the Rhino model>)
remap = RemapNumbers(Value=dprod, Source=bnd, Target=Domain(0, 1))  # -> Mapped, Clipped
remap_2 = RemapNumbers(Value=dprod_2, Source=bnd, Target=Domain(0, 1))  # -> Mapped, Clipped
remap_3 = RemapNumbers(Value=dprod_3, Source=bnd, Target=Domain(0, 1))  # -> Mapped, Clipped
box = Box({Plane=PlaneXY(35.25800544, 18.26682212, 0), X=Domain(0, 26.63721455), Y=Domain(0, 45.46522772), Z=Domain(0, 27.08728666)})
geo_3 = Geometry(<subd referenced from the Rhino model>)
box_2 = Box({Plane=PlaneXY(-39.31895903, 64.10189593, 0), X=Domain(0, 41.43740451), Y=Domain(0, 29.37623187), Z=Domain(0, 22.19404973)})
geo_4 = Geometry(<subd referenced from the Rhino model>)
texturesettings = TextureSettings(WrapS=0, WrapT=0, RepeatU=1, RepeatV=1, OffsetU=1, OffsetV=1, CenterU=1, CenterV=1, Rotation=0)
pop3d = Populate3D(Region=box, Count=Slider(500, range=0..500), Seed=1)
pop3d_2 = Populate3D(Region=box_2, Count=Slider(500, range=0..500), Seed=1)
rec = Rectangle({Plane=PlaneXY(-70.29298329, 26.79008764, 0), Size=Domain2(u=-65.57103248..65.57103248, v=-87.36188643..87.36188643)})
brep_2 = Brep(geo_2)
pdecon = Deconstruct(Point=pop3d)  # -> XComponent, YComponent, ZComponent
brep_3 = Brep(geo_3)
frgb = ColourRGBF(Alpha=1, Red=remap.Mapped, Green=remap_2.Mapped, Blue=remap_3.Mapped)
pdecon_2 = Deconstruct(Point=pop3d_2)  # -> XComponent, YComponent, ZComponent
brep_4 = Brep(geo_4)
path = FilePath("F:\Мой диск\Work\2022_08_LINE\DataVisualization\WebTest\GhToThreeJS\assets\Maps\Grass.jpg")
conmesh = ConstructMesh(Vertices=demesh.Vertices, Faces=demesh.Faces, Colours=frgb)
mesh_2 = MeshBrep(
    Brep=brep_2,
    Settings={GridMaxCount=0, GridMinCount=16, JaggedSeams=False, MaxEdgeLength=0, MinEdgeLength=0.0001, MinTolerance=0, Refine=True, RefineAngle=0, RelativeTolerance=0.65, SimplePlanes=True, Tolerance=0})
mesh_3 = MeshBrep(
    Brep=brep_3,
    Settings={GridMaxCount=0, GridMinCount=16, JaggedSeams=False, MaxEdgeLength=0, MinEdgeLength=0.0001, MinTolerance=0, Refine=True, RefineAngle=0, RelativeTolerance=0.65, SimplePlanes=True, Tolerance=0})
boundary = BoundarySurfaces(Edges=rec)
mesh_4 = MeshBrep(
    Brep=brep_4,
    Settings={GridMaxCount=0, GridMinCount=16, JaggedSeams=False, MaxEdgeLength=0, MinEdgeLength=0.0001, MinTolerance=0, Refine=True, RefineAngle=0, RelativeTolerance=0.65, SimplePlanes=True, Tolerance=0})
bnd_2 = Bounds(Numbers=pdecon.ZComponent)
bnd_3 = Bounds(Numbers=pdecon_2.ZComponent)
texture = Texture(ImagePath=path, MapSettings=texturesettings)
weld = WeldMesh(Mesh=conmesh, Angle=3.141592654)
remap_4 = RemapNumbers(Value=pdecon.ZComponent, Source=bnd_2, Target=Domain(0, 1))  # -> Mapped, Clipped
mesh_5 = Mesh(<mesh referenced from the Rhino model>)
remap_5 = RemapNumbers(Value=pdecon_2.ZComponent, Source=bnd_3, Target=Domain(0, 1))  # -> Mapped, Clipped
box_3 = Box({Plane=PlaneXY(-57.74848532, -30.25133852, 0), X=Domain(0, 8.506101741), Y=Domain(0, 19.87635718), Z=Domain(0, 89.40872297)})
mesh_6 = MeshBrep(
    Brep=boundary,
    Settings={GridMaxCount=0, GridMinCount=16, JaggedSeams=False, MaxEdgeLength=0, MinEdgeLength=0.0001, MinTolerance=0, Refine=True, RefineAngle=0, RelativeTolerance=0.65, SimplePlanes=True, Tolerance=0})
path_2 = FilePath("F:\Мой диск\Work\2022_08_LINE\DataVisualization\WebTest\GhToThreeJS\assets\Maps\M-001.jpg")
list = ValueList({"round", "miter", "bevel"}, selected="round")
box_4 = Box({Plane=PlaneXY(-6.853436257, -74.88278027, 0), X=Domain(0, 30.95252462), Y=Domain(0, 27.12815544), Z=Domain(0, 26.51036414)})
box_5 = Box({Plane=PlaneXY(37.35716022, -42.9034181, 0), X=Domain(0, 30.53486646), Y=Domain(0, 30.00759537), Z=Domain(0, 15.05303822)})
texture_2 = Texture(ImagePath=path_2)
path_3 = FilePath("F:\Мой диск\Work\2022_08_LINE\DataVisualization\WebTest\GhToThreeJS\assets\Maps\M-001.jpg")
gradient = Gradient(
    LowerLimit=0,
    UpperLimit=1,
    Parameter=remap_4.Mapped,
    stops=[0: RGB(0, 128, 0), 0.5: RGB(255, 255, 0), 1: RGB(255, 0, 0)])
meshstandardmaps = MeshStandardMaterialMaps(
    Map=texture,
    AlphaTest=0.5,
    BumpMap=texture,
    BumpScale=Slider(0.65, range=0..1),
    DisplacementScale=1,
    EnvMapIntensity=1,
    AoMapIntensity=1)
gradient_2 = Gradient(
    LowerLimit=0,
    UpperLimit=1,
    Parameter=remap_5.Mapped,
    stops=[0: RGB(243, 57, 0), 0.1: RGB(236, 27, 60), 0.2: RGB(210, 0, 118), 0.3: RGB(103, 0, 120), 0.4: RGB(39, 72, 161), 0.5: RGB(1, 192, 229), 0.6: RGB(18, 178, 90), 0.7: RGB(79, 186, 8), 0.8: RGB(220, 237, 32), 0.9: RGB(247, 159, 20), 1: RGB(243, 57, 0)])
bbox = BoundingBox(Content=mesh_5, Plane=PlaneXY(0, 0, 0))  # -> Box, Box_2
wireframe = WireframeSettings(WireframeLineJoin=list, WireframeLineWidth=Slider(2, range=0..10))
box_6 = Box({Plane=PlaneXY(-59.38156479, -75.71666951, 0), X=Domain(0, 32.50285286), Y=Domain(0, 19.15094821), Z=Domain(0, 26.33292242)})
pop3d_3 = Populate3D(Region=box_4, Count=Slider(100, range=0..100), Seed=1)
pop3d_4 = Populate3D(Region=box_5, Count=Slider(22, range=0..100), Seed=1)
mesh_7 = MeshBrep(
    Brep=box_3,
    Settings={GridMaxCount=0, GridMinCount=16, JaggedSeams=False, MaxEdgeLength=0, MinEdgeLength=0.0001, MinTolerance=0, Refine=True, RefineAngle=0, RelativeTolerance=0.65, SimplePlanes=True, Tolerance=0})
texture_3 = Texture(ImagePath=path_3)
edges = BrepEdges(Brep=box_6)  # -> Naked, Interior, NonManifold
basicmat = MeshBasicMaterial(Color=ColourSwatch(SwatchColor=RGB(161, 161, 161)))
shadowmat = ShadowMaterial(Color=RGB(0, 0, 0), Opacity=Slider(0.5, range=0..1))
normalmat = MeshNormalMaterial(Wireframe=False, WireframeLineJoin="round", WireframeLineWidth=1)
standardmat = MeshStandardMaterial(
    Color=RGB(255, 255, 255),
    Opacity=1,
    Roughness=1,
    Metalness=0.5,
    Emissive=RGB(0, 0, 0),
    EmissiveIntensity=1,
    Maps=meshstandardmaps)
standardmat_2 = MeshStandardMaterial(
    Color=ColourSwatch(SwatchColor=RGB(224, 224, 224)),
    Opacity=1,
    Roughness=Slider(0.31, range=0..1),
    Metalness=Slider(0.15, range=0..1),
    Emissive=RGB(0, 0, 0),
    EmissiveIntensity=1)
pointsmat = PointsMaterial(Color=RGB(255, 255, 255), Size=Slider(2, range=0..10), SizeAttenuation=True, AlphaTest=0.5)
pointsmat_2 = PointsMaterial(Color=RGB(255, 255, 255), Size=Slider(2, range=0..10), SizeAttenuation=True, AlphaMap=texture_3, AlphaTest=0.5)
pointsmat_3 = PointsMaterial(Color=RGB(255, 255, 255), Size=Slider(10, range=0..10), SizeAttenuation=Toggle(False), AlphaTest=0.5)
pointsmat_4 = PointsMaterial(
    Color=ColourSwatch(SwatchColor=RGB(0, 255, 255)),
    Size=Slider(15, range=0..30),
    SizeAttenuation=Toggle(True),
    AlphaMap=texture_2,
    AlphaTest=0.5)
pt = Point(Point(-4.263042858, -64.963699, 11.10431746))
pt_2 = Point(Point(-40.82854297, 43.15121085, 42.47653242))
edges_2 = BrepEdges(Brep=bbox.Box)  # -> Naked, Interior, NonManifold
mesh_8 = Mesh(Mesh=mesh_7, Material=shadowmat, DecimalAccuracy=3)
mesh_9 = Mesh(Mesh=mesh_2, Material=basicmat, DecimalAccuracy=3)
mesh_10 = Mesh(Mesh=mesh_3, Material=normalmat, DecimalAccuracy=3)
mesh_11 = Mesh(Mesh=mesh_4, Material=standardmat, DecimalAccuracy=3)
standardmat_3 = MeshStandardMaterial(
    Color=ColourSwatch(SwatchColor=RGB(230, 230, 230)),
    Opacity=1,
    Roughness=Slider(0.1, range=0..1),
    Metalness=Slider(0.2, range=0..1),
    Emissive=RGB(0, 0, 0),
    EmissiveIntensity=1)
ptlight = PointLight(
    Position=pt,
    Color=ColourSwatch(SwatchColor=RGB(191, 234, 255)),
    Intensity=Slider(1.9, range=0..10),
    Distance=0,
    Decay=1,
    CastShadow=Toggle(True))  # -> Helper, Light
mesh_12 = Mesh(<mesh referenced from the Rhino model>)
pointvertexcolors = PointVertexColors(Points=pop3d, PointsMaterial=pointsmat, Colors=gradient, DecimalAccuracy=3)
mesh_13 = Mesh(Mesh=mesh_6, Material=standardmat_2, DecimalAccuracy=3)
ptlight_2 = PointLight(
    Position=pt_2,
    Color=ColourSwatch(SwatchColor=RGB(255, 235, 191)),
    Intensity=1,
    Distance=0,
    Decay=1,
    CastShadow=Toggle(True))  # -> Helper, Light
hemilight = HempisphereLight(
    Color=ColourSwatch(SwatchColor=RGB(255, 255, 255)),
    GroundColor=ColourSwatch(SwatchColor=RGB(176, 176, 176)),
    Intensity=Slider(0.265, range=0..1))
pointvertexcolors_2 = PointVertexColors(Points=pop3d_2, PointsMaterial=pointsmat_2, Colors=gradient_2, DecimalAccuracy=3)
points = Points(Points=pop3d_3, PointsMaterial=pointsmat_3, DecimalAccuracy=3)
points_2 = Points(Points=pop3d_4, PointsMaterial=pointsmat_4, DecimalAccuracy=3)
standardmat_4 = MeshStandardMaterial(
    Color=RGB(255, 255, 255),
    Opacity=1,
    Roughness=Slider(0.3, range=0..1),
    Metalness=Slider(0.2, range=0..1),
    Emissive=RGB(0, 0, 0),
    EmissiveIntensity=1)
linedashmat = LineDashedMaterial(
    Color=ColourSwatch(SwatchColor=RGB(255, 0, 0)),
    LineWidth="3",
    DashSize=Slider(2, range=0..10),
    GapSize=Slider(1.5, range=0..10))
linebasicmat = LineBasicMaterial(Color=ColourSwatch(SwatchColor=RGB(0, 0, 0)), LineWidth=1)
meshvertex = MeshVertexColors(Mesh=weld, Material=standardmat_4, DecimalAccuracy=3)
line = Line(Line=edges.Interior, LineMaterial=linedashmat, DecimalAccuracy=3)
line_2 = Line(Line=edges_2.Interior, LineMaterial=linebasicmat, DecimalAccuracy=3)
mesh_14 = Mesh(Mesh=mesh_12, Name="SubD", Material=standardmat_3, DecimalAccuracy=3)
merge = Merge(
    Data1=ptlight_2.Light,
    Data2=ptlight.Light,
    Data3=hemilight,
    Data4=mesh_14,
    Data5=line_2,
    Data6=line,
    Data7=meshvertex,
    Data8=points,
    Data9=points_2,
    Data10=pointvertexcolors,
    Data11=pointvertexcolors_2,
    Data12=mesh_13,
    Data13=mesh_11,
    Data14=mesh_10,
    Data15=mesh_9,
    Data16=mesh_8)
panel = Panel("F:\Мой диск\Work\2022_08_LINE\DataVisualization\WebTest\TRICERATOPS\assets")
fog = Fog(Color=RGB(255, 255, 255), Near=Slider(250, range=0..1000), Far=Slider(600, range=0..1000))
scene = CompileScene(Objects=flatten(merge), BackgroundColor=ColourSwatch(SwatchColor=RGB(87, 87, 87)), Fog=fog)
serialize = SerializeObject(Object3d=scene, Minify=False, Run=True)
writetxt = WriteTextFile(Path=panel, FileName="SubD.json", Data=serialize, Write=Button())
